# Grasshopper definition bimsc25-aymrc-sandbox.gh (Grasshopper 1.0.8)

find_assemblies = GhPythonScript()  # -> out
# ---------- find_assemblies: Python ----------
import Grasshopper as gh

this = ghenv.Component
thisDoc = this.OnPingDocument()

asms = []

for obj in thisDoc.Objects:
    #print obj.GetType().BaseType
    
    #if obj.Obsolete: print 'Warning: Obsolete'
    #print 'Name: {}\nDescription: {}\nCategory: {} -> {}\n '.format(obj.Name, obj.Description, obj.Category, obj.SubCategory)
    #print 'Pivot: {} \t Bounds: {}'.format(obj.Attributes.Pivot, obj.Attributes.Bounds)
    
    asm = gh.Instances.ComponentServer.FindAssemblyByObject(obj.ComponentGuid)
    
    #print(x.IsCoreLibrary)
    if asm is not None and not asm.IsCoreLibrary:
        asms.append(asm.Name)
    
print asms
# ---------- end find_assemblies ----------
panel = Panel(find_assemblies)
number_slider = Slider(3.5, range=0..20)
number_slider_2 = Slider(7.5, range=0..20)
point = Point([Point(-45.69336157, 52.60173298, 0), Point(36.21299977, 16.11486325, 0), Point(-22.43646226, -34.38848824, 0), Point(37.22718183, -95.6460768, 0)])
point_2 = Point([Point(-58.16308369, -1.410276058, 0), Point(5.701516371, 21.07526476, 0), Point(58.31444825, -60.62230813, 0)])
pointspathcurve = GetPoint(point, AtLeast=1, AtMost=5, Realtime=True, TreeAccess=False)
pointsbldgcurve = GetPoint(point_2, AtLeast=1, AtMost=5, Realtime=True, TreeAccess=False)
sideoffest = GetBoolean(Toggle(True), AtLeast=1, AtMost=1, FalseValue="False", TreeAccess=False, TrueValue="True")
bldgheight = GetInteger(
    Slider(16, range=0..100),
    {"16"}, selected=[],
    AtLeast=1,
    AtMost=1,
    Maximum=2147483647,
    Minimum=-2147483648,
    TreeAccess=False)
seed = GetInteger(
    Slider(8, range=0..10),
    {"0"}, selected=[],
    AtLeast=1,
    AtMost=1,
    Maximum=2147483647,
    Minimum=-2147483648,
    TreeAccess=False)
polyline = PolyLine(Vertices=pointsbldgcurve, Closed=False)
negative = Negative(Value=number_slider_2)
weave = Weave(Pattern=sideoffest, Stream0=number_slider_2, Stream1=negative, NullGaps=False)
circle = Circle(Plane=PlaneXY(0, 0, 0), Radius=Slider(35, range=5..200))
negative_2 = Negative(Value=Slider(1, range=0.1..5))
surface = Surface(circle)

# ---- group: path offset
interpolate = Interpolate(Vertices=pointspathcurve, Degree=3, Periodic=False, KnotStyle=1)  # -> Curve, Length, Domain
negative_3 = Negative(Value=number_slider)
offset_curve = OffsetCurve(Curve=interpolate.Curve, Distance=number_slider, Corners=1)
offset_curve_2 = OffsetCurve(Curve=interpolate.Curve, Distance=negative_3, Corners=1)
trim_with_region = TrimWithRegion(Curve=offset_curve, Region=surface)  # -> Inside, Outside
trim_with_region_2 = TrimWithRegion(Curve=offset_curve_2, Region=surface)  # -> Inside, Outside

# ----
trim_with_region_3 = TrimWithRegion(Curve=polyline, Region=surface)  # -> Inside, Outside
offset_curve_3 = OffsetCurve(Curve=trim_with_region_3.Inside, Distance=weave, Corners=1)
explode = Explode(Curve=trim_with_region_3.Inside, Recursive=True)  # -> Segments, Vertices
explode_2 = Explode(Curve=offset_curve_3, Recursive=True)  # -> Segments, Vertices
ruled_surface = RuledSurface(CurveA=trim_with_region_3.Inside, CurveB=offset_curve_3)
divide_length = DivideLength(Curve=explode.Segments, Length=Slider(5, range=0..10))  # -> simplify(Points), Tangents, Parameters
tree_statistics = TreeStatistics(Tree=divide_length.Points)  # -> Paths, Length, Count
perp_frames = PerpFrames(Curve=explode.Segments, Count=tree_statistics.Length, Align=True)  # -> Frames, Parameters
cull_index = CullIndex(List=perp_frames.Frames, Indices=[0, -1], Wrap=True)  # -> simplify(List)
curve_plane = CurvePlane(Curve=graft(explode_2.Segments), Plane=cull_index)  # -> simplify(Points), ParamsC, ParamsP
end_points = EndPoints(Curve=explode.Segments)  # -> Start, End
end_points_2 = EndPoints(Curve=explode_2.Segments)  # -> Start, End
trim_tree = TrimTree(Tree=curve_plane.Points, Depth=1)
line = Line(StartPoint=end_points.End, EndPoint=end_points_2.End)
line_2 = Line(StartPoint=cull_index, EndPoint=trim_tree)  # -> flatten(Line)

ruled_surface_2 = RuledSurface(CurveA=trim_with_region.Inside, CurveB=trim_with_region_2.Inside)
xy_plane = XYPlane(Origin=Point(0, 0, 0))
project = Project(Geometry=ruled_surface_2, Plane=xy_plane)  # -> Geometry, Transform
region_difference = RegionDifference(CurvesA=ruled_surface, CurvesB=project.Geometry, Plane=xy_plane)
surface_2 = Surface(region_difference)
area = Area(Geometry=surface_2)  # -> Area, Centroid

# ---- group: divide volume
end_points_3 = EndPoints(Curve=trim_with_region_3.Inside)  # -> Start, End
end_points_4 = EndPoints(Curve=offset_curve_3)  # -> Start, End
line_3 = Line(StartPoint=end_points_3.Start, EndPoint=end_points_4.Start)
line_4 = Line(StartPoint=end_points_3.End, EndPoint=end_points_4.End)
merge = Merge(Data1=line_3, Data2=line_4, Data3=line, Data4=line_2)  # -> flatten(Result)
end_points_5 = EndPoints(Curve=merge)  # -> Start, End
sort_along_curve = SortAlongCurve(Points=end_points_5.Start, Curve=trim_with_region_3.Inside)  # -> Points, Indices
list_item = ListItem(List=merge, Index=sort_along_curve.Indices, Wrap=True)
surface_split = SurfaceSplit(Surface=surface_2, Curves=list_item)  # -> flatten(Fragments)

# ---- group: heights
number_slider_3 = Slider(2.8, range=2.5..4)
division = Division(A=bldgheight, B=number_slider_3)
round = Round(Number=division)  # -> Nearest, Floor, Ceiling
multiplication = Multiplication(A=number_slider_3, B=round.Nearest)
construct_domain = ConstructDomain(DomainStart=number_slider_3, DomainEnd=multiplication)
list_length = ListLength(List=surface_split)
random = Random(Range=construct_domain, Number=list_length, Seed=seed)
unit_z = UnitZ(Factor=random)

# ----
extrude = Extrude(Base=surface_split, Direction=unit_z)
volume = Volume(Geometry=extrude)  # -> Volume, Centroid
smaller_than = SmallerThan(FirstNumber=volume.Volume, SecondNumber=Slider(64.4, range=0..100))  # -> SmallerThan, OrEqualTo
dispatch = Dispatch(List=extrude, DispatchPattern=smaller_than.SmallerThan)  # -> ListA, ListB
data = Data(dispatch.ListB)

area_2 = Area(Geometry=surface)  # -> Area, Centroid
unit_z_2 = UnitZ(Factor=negative_2)
panel_2 = Panel(area_2.Area)
extrude_2 = Extrude(Base=surface, Direction=unit_z_2)
offset_curve_4 = OffsetCurve(Curve=surface, Distance=-2, Corners=1)
surface_3 = Surface(offset_curve_4)
populate_geometry = PopulateGeometry(Geometry=surface_3, Count=100, Seed=1)
contour = Contour(Shape=simplify(data), Point=Point(0, 0, 0), Direction=Vector(0, 0, 1), Distance=number_slider_3)

trim_tree_2 = TrimTree(Tree=contour, Depth=1)
tree_statistics_2 = TreeStatistics(Tree=simplify(trim_tree_2))  # -> Paths, Length, Count
sort_list = SortList(Keys=tree_statistics_2.Length)  # -> reverse(Keys), ValuesValuesA
list_item_2 = ListItem(List=sort_list.Keys, Index=0, Wrap=True)
concatenate = Concatenate(FragmentA="floors max: ", FragmentB=list_item_2)

offset_curve_5 = OffsetCurve(Curve=ruled_surface, Distance=1, Corners=1)
surface_4 = Surface(contour)
curve = Curve(flatten(contour))
area_3 = Area(Geometry=surface_4)  # -> Area, Centroid
point_in_curves = PointInCurves(Point=populate_geometry, Curves=flatten([offset_curve_5, project.Geometry]))  # -> Relationship, Index, Point
mass_addition = MassAddition(Input=area_3.Area)  # -> Result, PartialResults
mass_addition_2 = MassAddition(Input=flatten(area_3.Area))  # -> Result, PartialResults
dispatch_2 = Dispatch(List=point_in_curves.Point, DispatchPattern=point_in_curves.Relationship)  # -> ListA, ListB
concatenate_2 = Concatenate(FragmentA="total m²", FragmentB=mass_addition_2.Result)
panel_3 = Panel(mass_addition.Result)
line_sdl = LineSDL(Start=dispatch_2.ListB, Direction=Vector(0, 0, 1), Length=Slider(4, range=0..10))
panel_4 = Panel([concatenate, concatenate_2])
brep = Brep(data)
mesh_brep = MeshBrep(
    Brep=brep,
    Settings={GridMaxCount=0, GridMinCount=16, JaggedSeams=False, MaxEdgeLength=0, MinEdgeLength=0.0001, MinTolerance=0, Refine=True, RefineAngle=0, RelativeTolerance=0.65, SimplePlanes=True, Tolerance=0})

context_bake = ContextBake(PathCurve=interpolate.Curve)
context_bake_2 = ContextBake(BuildingLine=polyline)
context_bake_3 = ContextBake(BuildingBrep=mesh_brep)
context_bake_4 = ContextBake(Content=line_sdl)
context_bake_5 = ContextBake(Content=extrude_2)
context_print = ContextPrint(TotalArea=mass_addition_2.Result)
context_print_2 = ContextPrint(BldgFootprint=area.Area)
context_print_3 = ContextPrint(MaxFloors=list_item_2)
context_print_4 = ContextPrint(SiteArea=panel_2)
context_bake_6 = ContextBake(SlabsSurface=curve)
